# Grasshopper definition TDDGH.gh (Grasshopper 1.0.7)

# ---- group: SpiralLines
crv = Curve()

# ---- group: CenterLine
crv_2 = Curve()

# ----
# Create Spiral Stair
length = Length()
totalrotation = TotalRotation()
dividenumber = DivideNumber()
# 1. 入力と出力を決める
hight = Hight()
centerline = CenterLine(crv_2)
spirallines = SpiralLines(crv)

# ---- group: Hight
num = Number(hight)

# ---- group: Length
num_2 = Number(length)

# ---- group: TotalRotation
num_3 = Number(totalrotation)

# ---- group: NumberOfStairs
int = Integer(dividenumber)

# ----
dividenumber_2 = DivideNumber()

# ---- group: NumberOfStairs
int_2 = Integer(dividenumber_2)

# ---- group: DividePoints
pt = Point()

# ----
# Divide Center Line
centerline_2 = CenterLine()
dividepoints = DividePoints(pt)

# ---- group: CenterLine
crv_3 = Curve(centerline_2)

crv_4 = Curve()

# ----
# 2. いい感じにモジュールに分けて、それぞれテストのガラを書く
# Create Center Line
hight_2 = Hight()
centerline_3 = CenterLine(crv_4)

# ---- group: Hight
num_4 = Number(hight_2)

# ---- group: SpiralLines
crv_5 = Curve()

# ----
# Create Spiral Lines
length_2 = Length()
totalrotation_2 = TotalRotation()
hight_3 = Hight()
dividedpoints = DividedPoints()
spirallines_2 = SpiralLines(crv_5)

# ---- group: Hight
num_5 = Number(hight_3)

# ---- group: DividedPoints
pt_2 = Point(dividedpoints)

# ---- group: Length
num_6 = Number(length_2)

# ---- group: TotalRotation
num_7 = Number(totalrotation_2)

# ---- group: DividePoints
pt_3 = Point()

# ---- group: SpiralLinesExpected
crv_6 = Curve([<curve referenced from the Rhino model> x10])

# ---- group: CenterLineExpected
crv_7 = Curve(<curve referenced from the Rhino model>)

# ---- group: DividePointsExpected
geo = Geometry([<point referenced from the Rhino model> x11, <curve referenced from the Rhino model>])

# ---- group: CenterLine
crv_8 = Curve()

# ----
# Test Create Center Line
result = Result()

# ----
# Test Create Spiral Lines
result_2 = Result()

# ----
# Test Divide Center Line
result_3 = Result()

pt_4 = ConstructPoint(XCoordinate="0", YCoordinate="0", ZCoordinate="0")

# ---- group: DividePoints
pt_5 = Point()

# ---- group: SpiralLinesExpected
crv_9 = Curve([<curve referenced from the Rhino model> x10])

# ---- group: CenterLineExpected
crv_10 = Curve(<curve referenced from the Rhino model>)

# ---- group: DividePointsExpected
geo_2 = Geometry([<point referenced from the Rhino model> x11, <curve referenced from the Rhino model>])

# ---- group: CenterLine
crv_11 = Curve()

# ----
# Test Divide Center Line
dist = Distance(PointA=pt_5, PointB=geo_2)
ma = MassAddition(Input=dist)  # -> Result, PartialResults
expression = Expression(x=ma.Result, Expression="if(x<0.0001,\"Passed\",\"Failed\")")
panel = Panel(expression)

# ----
# Test Create Spiral Lines
end = EndPoints()  # -> Start, End
end_2 = EndPoints(Curve=crv_9)  # -> Start, End
dist_2 = Distance(PointA=end.Start, PointB=end_2.Start)
dist_3 = Distance(PointA=end.End, PointB=end_2.End)
addition = Addition(A=dist_2, B=dist_3)
expression_2 = Expression(x=addition, Expression="if(x<0.0001,\"Passed\",\"Failed\")")
panel_2 = Panel(expression_2)

# ----
# Test Create Center Line
end_3 = EndPoints(Curve=crv_11)  # -> Start, End
end_4 = EndPoints(Curve=crv_10)  # -> Start, End
dist_4 = Distance(PointA=end_3.Start, PointB=end_4.Start)
dist_5 = Distance(PointA=end_3.End, PointB=end_4.End)
addition_2 = Addition(A=dist_4, B=dist_5)
expression_3 = Expression(x=addition_2, Expression="if(x<0.0001,\"Passed\",\"Failed\")")
panel_3 = Panel(expression_3)

# ----
# 4. クラスター化してテストの実行をする
panel_4 = Panel("70")

# ---- group: Hight
num_8 = Number(panel_4)

# ---- group: DividedPoints
pt_6 = Point([Point(0, 0, 0), Point(0, 0, 7), Point(0, 0, 14), Point(0, 0, 21), Point(0, 0, 28), Point(0, 0, 35), Point(0, 0, 42), Point(0, 0, 49), Point(0, 0, 56), Point(0, 0, 63), Point(0, 0, 70)])

# ---- group: CenterLineExpected
crv_12 = Curve(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)

# ---- group: Length
num_9 = Number("70")

# ---- group: TotalRotation
num_10 = Number("2*PI")

# ---- group: SpiralLinesExpected
crv_13 = Curve([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])

# ---- group: CenterLine
crv_14 = Curve(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)

# ---- group: NumberOfStairs
int_3 = Integer("10")

# ---- group: DividePointsExpected
geo_3 = Geometry([Point(0, 0, 0), Point(0, 0, 7), Point(0, 0, 14), Point(0, 0, 21), Point(0, 0, 28), Point(0, 0, 35), Point(0, 0, 42), Point(0, 0, 49), Point(0, 0, 56), Point(0, 0, 63), Point(0, 0, 70)])

# ----
# Create Center Line
cluster = Cluster(hight=num_8)

# ----
# Divide Center Line
cluster_2 = Cluster_2(centerline=crv_14, dividenumber=int_3)

# ----
# Create Spiral Lines
cluster_3 = Cluster_3(dividedpoints=pt_6, length=num_9, totalrotation=num_10)

# ----
# Test Create Center Line
cluster_4 = Cluster_4(centerline=cluster, centerlineexpected=crv_12)

# ----
# Test Divide Center Line
cluster_5 = Cluster_5(pt=cluster_2, dividepointsexpected=geo_3)

# ----
# Test Create Spiral Lines
cluster_6 = Cluster_6(spirallines=cluster_3, spirallinesexpected=crv_13)

panel_5 = Panel(cluster_4)
panel_6 = Panel(cluster_5)
panel_7 = Panel(cluster_6)
dividenumber_3 = DivideNumber()

# ---- group: NumberOfStairs
int_4 = Integer(dividenumber_3)

# ----
# Create Spiral Stair
number_slider = Slider(100, range=0..100)
pi = Pi(Factor=Slider(2, range=0..2))
cluster_7 = Cluster_7(hight=number_slider, length=Slider(100, range=0..100), totalrotation=pi, dividenumber=Slider(10, range=0..10))  # -> centerline, spirallines

# ----
# Divide Center Line
centerline_4 = CenterLine()
dividenumber_4 = DivideNumber()

# ---- group: NumberOfStairs
int_5 = Integer(dividenumber_4)

# ---- group: CenterLine
crv_15 = Curve(centerline_4)

# ----
divide = DivideCurve(Curve=crv_15, Count=int_5, Kinks=False)  # -> Points, Tangents, Parameters

# ---- group: DividedPoints
pt_7 = Point(divide.Points)

# ----
dividepoints_2 = DividePoints(pt_7)

# ----
# 3. 実装とテストを書く
# Create Center Line
hight_4 = Hight()

# ---- group: Hight
num_11 = Number(hight_4)

# ----
Z = UnitZ(Factor=num_11)
move = Move(Geometry=pt_4, Motion=Z)  # -> Geometry, Transform
ln = Line(StartPoint=pt_4, EndPoint=move.Geometry)

# ---- group: CenterLine
crv_16 = Curve(ln)

# ----
centerline_5 = CenterLine(crv_16)

# ----
# Create Spiral Lines
length_3 = Length()
dividedpoints_2 = DividedPoints()
totalrotation_3 = TotalRotation()

# ---- group: DividedPoints
pt_8 = Point(dividedpoints_2)

# ---- group: Length
num_12 = Number(length_3)

# ---- group: TotalRotation
num_13 = Number(totalrotation_3)

# ----
cull_i = CullIndex(List=pt_8, Indices=0, Wrap=True)
lng = ListLength(List=cull_i)
X = UnitX(Factor=num_12)
division = Division(A=num_13, B=lng)
move_2 = Move(Geometry=cull_i, Motion=X)  # -> Geometry, Transform
series = Series(Start=0, Step=division, Count=lng)
rotate = Rotate(Geometry=move_2.Geometry, Angle=series, Plane=PlaneXY(0, 0, 0))  # -> Geometry, Transform
ln_2 = Line(StartPoint=cull_i, EndPoint=rotate.Geometry)

# ---- group: SpiralLines
crv_17 = Curve(ln_2)

# ----
spirallines_3 = SpiralLines(crv_17)

# ----
# Create Spiral Stair
length_4 = Length()
totalrotation_4 = TotalRotation()
# 5.各モジュールを組み合わせてコンポーネントにする
hight_5 = Hight()

# ---- group: Hight
num_14 = Number(hight_5)

# ---- group: Length
num_15 = Number(length_4)

# ---- group: TotalRotation
num_16 = Number(totalrotation_4)

# ----
cluster_8 = Cluster(hight=num_14)
cluster_9 = Cluster_2(centerline=cluster_8, dividenumber=int_4)
cluster_10 = Cluster_3(dividedpoints=cluster_9, length=num_15, totalrotation=num_16)

# ---- group: SpiralLines
crv_18 = Curve(cluster_10)

# ---- group: CenterLine
crv_19 = Curve(cluster_8)

# ----
centerline_6 = CenterLine(crv_19)
spirallines_4 = SpiralLines(crv_18)

# ==== cluster Cluster
pt = ConstructPoint(XCoordinate="0", YCoordinate="0", ZCoordinate="0")

# ----
# Create Center Line
hight = ClusterInput()

# ---- group: Hight
num = Number(hight)

# ----
Z = UnitZ(Factor=num)
move = Move(Geometry=pt, Motion=Z)  # -> Geometry, Transform
ln = Line(StartPoint=pt, EndPoint=move.Geometry)

# ---- group: CenterLine
crv = Curve(ln)

# ----
centerline = ClusterOutput(crv)

# ==== cluster Cluster_2

# ----
# Divide Center Line
centerline = ClusterInput()
dividenumber = ClusterInput()

# ---- group: NumberOfStairs
int = Integer(dividenumber)

# ---- group: CenterLine
crv = Curve(centerline)

# ----
divide = DivideCurve(Curve=crv, Count=int, Kinks=False)  # -> Points, Tangents, Parameters

# ---- group: DividedPoints
pt = Point(divide.Points)

# ----
dividepoints = ClusterOutput(pt)

# ==== cluster Cluster_3

# ----
# Create Spiral Lines
length = ClusterInput()
dividedpoints = ClusterInput()
totalrotation = ClusterInput()

# ---- group: Length
num = Number(length)

# ---- group: DividedPoints
pt = Point(dividedpoints)

# ---- group: TotalRotation
num_2 = Number(totalrotation)

# ----
cull_i = CullIndex(List=pt, Indices=0, Wrap=True)
lng = ListLength(List=cull_i)
X = UnitX(Factor=num)
division = Division(A=num_2, B=lng)
move = Move(Geometry=cull_i, Motion=X)  # -> Geometry, Transform
series = Series(Start=0, Step=division, Count=lng)
rotate = Rotate(Geometry=move.Geometry, Angle=series, Plane=PlaneXY(0, 0, 0))  # -> Geometry, Transform
ln = Line(StartPoint=cull_i, EndPoint=rotate.Geometry)

# ---- group: SpiralLines
crv = Curve(ln)

# ----
spirallines = ClusterOutput(crv)

# ==== cluster Cluster_4
centerlineexpected = ClusterInput()

# ---- group: CenterLineExpected
crv = Curve(centerlineexpected)

# ----
# Test Create Center Line
centerline = ClusterInput()
end = EndPoints(Curve=crv)  # -> Start, End

# ---- group: CenterLine
crv_2 = Curve(centerline)

# ----
end_2 = EndPoints(Curve=crv_2)  # -> Start, End
dist = Distance(PointA=end_2.Start, PointB=end.Start)
dist_2 = Distance(PointA=end_2.End, PointB=end.End)
addition = Addition(A=dist, B=dist_2)
expression = Expression(x=addition, Expression="if(x<0.0001,\"Passed\",\"Failed\")")
panel = Panel(expression)
result = ClusterOutput(expression)

# ==== cluster Cluster_5
dividepointsexpected = ClusterInput()
pt = ClusterInput()

# ---- group: DividedPoints
pt_2 = Point(pt)

# ---- group: DividePointsExpected
geo = Geometry(dividepointsexpected)

# ----
# Test Divide Center Line
dist = Distance(PointA=pt_2, PointB=geo)
ma = MassAddition(Input=dist)  # -> Result, PartialResults
expression = Expression(x=ma.Result, Expression="if(x<0.0001,\"Passed\",\"Failed\")")
panel = Panel(expression)

result = ClusterOutput(expression)

# ==== cluster Cluster_6
spirallines = ClusterInput()
spirallinesexpected = ClusterInput()

# ---- group: SpiralLinesExpected
crv = Curve(spirallinesexpected)

# ----
# Test Create Spiral Lines
end = EndPoints(Curve=spirallines)  # -> Start, End
end_2 = EndPoints(Curve=crv)  # -> Start, End
dist = Distance(PointA=end.Start, PointB=end_2.Start)
dist_2 = Distance(PointA=end.End, PointB=end_2.End)
addition = Addition(A=dist, B=dist_2)

ma = MassAddition(Input=addition)  # -> Result, PartialResults

expression = Expression(x=ma.Result, Expression="if(x<0.0001,\"Passed\",\"Failed\")")
panel = Panel(expression)

result = ClusterOutput(expression)

# ==== cluster Cluster_7
dividenumber = ClusterInput()

# ---- group: NumberOfStairs
int = Integer(dividenumber)

# ----
# Create Spiral Stair
length = ClusterInput()
totalrotation = ClusterInput()
hight = ClusterInput()

# ---- group: Hight
num = Number(hight)

# ---- group: Length
num_2 = Number(length)

# ---- group: TotalRotation
num_3 = Number(totalrotation)

# ----
cluster = Cluster(hight=num)
cluster_2 = Cluster_2(centerline=cluster, dividenumber=int)
cluster_3 = Cluster_3(dividedpoints=cluster_2, length=num_2, totalrotation=num_3)

# ---- group: SpiralLines
crv = Curve(cluster_3)

# ---- group: CenterLine
crv_2 = Curve(cluster)

# ----
centerline = ClusterOutput(crv_2)
spirallines = ClusterOutput(crv)
